# Grasshopper definition The Intersection Cube.gh (Grasshopper 1.0.7)

c_script = CSharpScript(radius=Slider(115, range=0..1000), count=Slider(711, range=0..1000))  # -> out, A, B; inputs radius: Double, count: Int32
# ---------- c_script: C# ----------
    //lets create a sphere first
    Point3d origin = new Point3d(0, 0, 0);
    Vector3d normal = new Vector3d(0, 0, 1);
    Plane plane = new Plane(origin, normal);


    Sphere s = new Sphere(plane, radius);

    //create a list for the random points on sphere
    List <Point3d> pList = new List <Point3d>();

    Random rnd = new Random();
    for (int i = 0; i < count; i++)
    {
      //generate spherical coordinates
      double u = 2 * Math.PI * rnd.NextDouble(); //longitudinal
      double v = Math.Acos(2 * rnd.NextDouble() - 1); //latitudinal

      //generate a random radius value that is less than or equal to the sphere's radius
      double randomRadius = radius * Math.Pow(rnd.NextDouble(), 1.0 / 3.0); //cubic root for uniform distribution

      //convert spherical coordinates to cartesian coordinates inside the sphere
      double x = origin.X + randomRadius * Math.Sin(v) * Math.Cos(u);
      double y = origin.Y + randomRadius * Math.Sin(v) * Math.Sin(u);
      double z = origin.Z + randomRadius * Math.Cos(v);

      //add the point to the list
      pList.Add(new Point3d(x, y, z));
    }

    B = pList; //output for the points
    A = s; //output for the sphere
# ---------- end c_script ----------
voronoi³ = Voronoi3D(Points=c_script.B)  # -> Cells, Boundary
c_script_2 = CSharpScript(breps=voronoi³.Cells)  # -> out, A; inputs breps: list of Brep
# ---------- c_script_2: C# usings ----------
using Rhino.Geometry.Intersect;
# ---------- c_script_2: C# ----------
    List<Brep> sortedBreps = new List<Brep>();

    if(breps != null && breps.Count >= 150)
    {

      sortedBreps.AddRange(breps.GetRange(0, 150));


    }

    A = sortedBreps;
# ---------- end c_script_2 ----------
c_script_3 = CSharpScript(breps=voronoi³.Cells)  # -> out, A, B; inputs breps: list of Brep
# ---------- c_script_3: C# ----------
    List<Brep> sortedBreps = new List<Brep>();
    List<Brep> remainingBreps = new List<Brep>();

    if(breps != null && breps.Count > 0)
    {
      int count = Math.Min(150, breps.Count);
      sortedBreps.AddRange(breps.GetRange(0, count));

      if (breps.Count > 150)
      {

        remainingBreps.AddRange(breps.GetRange(150, breps.Count - 150));
      }
    }

    A = sortedBreps;
    B = remainingBreps;
# ---------- end c_script_3 ----------
debrep = DeconstructBrep(Brep=c_script_3.B)  # -> Faces, Edges, Vertices
debrep_2 = DeconstructBrep(Brep=c_script_2.A)  # -> Faces, Edges, Vertices
number_slider = Slider(20, range=0..100)
srf = Surface(graft(debrep.Faces))

geo = Geometry(c_script.A)
bbx = BrepBrep(BrepA=geo, BrepB=voronoi³.Cells)  # -> flatten(Curves), Points
c_script_4 = CSharpScript(curves=bbx.Curves)  # -> out, A; inputs curves: list of Curve
# ---------- c_script_4: C# ----------
    List<Curve> sortedCurves = new List<Curve>();


    if(curves != null && curves.Count >= 250)
    {

      sortedCurves.AddRange(curves.GetRange(0, 250));
      sortedCurves.Sort((a, b) => a.GetLength().CompareTo(b.GetLength()));
    }


    A = sortedCurves;
# ---------- end c_script_4 ----------
pipe = Pipe(Curve=c_script_4.A, Radius=Slider(1, range=0..1), Caps=Slider(1, range=0..10))
preview = CustomPreview(Geometry=pipe, Material=ColourSwatch(SwatchColor=RGB(97, 10, 10)))

srf_2 = Surface(flatten(debrep_2.Faces))
pipe_2 = Pipe(Curve=debrep_2.Edges, Radius=Slider(1, range=0..10), Caps=0)
fillet = Fillet(Curve=srf, Radius=number_slider)
fillet_2 = Fillet(Curve=srf_2, Radius=number_slider)  # -> graft(Curve)
srf_3 = Surface(fillet)
area = Area(Geometry=fillet_2)  # -> Area, Centroid
scale = Scale(Geometry=fillet_2, Center=area.Centroid, Factor=Slider(0.6, range=0..1))  # -> Geometry, Transform
boundary = BoundarySurfaces(Edges=[scale.Geometry, fillet_2])
offset = OffsetSurface(Surface=srf_3, Distance=Slider(0.1, range=0..1), Retrim=True)
preview_2 = CustomPreview(Geometry=boundary, Material=ColourSwatch(SwatchColor=RGB(125, 12, 12)))
